# Dynamo graph Minesweeper.dyn (Dynamo 2.0.3.8810)

string = StringInput("main.py")
file_from_path = FileObject(path=string)
readText = FileSystem.ReadText(file=file_from_path)
python_script_from_string = PythonStringNode(script=readText, IN[0]=file_from_path)
